# Dynamo graph 3_doors.dyn (Dynamo 2.12.0.5650)

boolean = BoolSelector(false)

# group: default inputs
# note: the main floor plan with the gridlines
views = Views("Ground Floor")

boolean_2 = BoolSelector(false)

# group: required input
# note: door height
number = DoubleInput(2950)

OS_PlaceDoor = Custom[OS_PlaceDoor](trigger_placement_point=boolean, gridlines_view=views, is_double_door=boolean_2, door_height=number)
